# Grasshopper definition CircleShape.gh (Grasshopper 0.9.80)

slider = Slider(2, range=0..10)
slider_2 = Slider(10.909, range=0..200)
multiplication = Multiplication(A=slider, B=-0.5)
panel = Panel("Main Circle")
circle = Circle(Plane=PlaneXY(0, 0, 0), Radius=Slider(20, range=0..40))
vector_xyz = VectorXYZ(XComponent=multiplication, YComponent=slider_2, ZComponent=0)  # -> Vector, Length
# Slits in the circle
rectangle = Rectangle(Plane=PlaneXY(0, 0, 0), XSize=slider, YSize=slider_2, Radius=0)  # -> Rectangle, Length
move = Move(Geometry=rectangle.Rectangle, Motion=vector_xyz.Vector)  # -> Geometry, Transform
# Function used to get the point of slits correct
number = Number(4)
# Polar array used to add slits in the circle
polar_array = PolarArray(Geometry=move.Geometry, Plane=PlaneXY(0, 0, 0), Count=number, Angle=6.283185307)  # -> Geometry, Transform
# Used to trim final shape
region_difference = RegionDifference(CurvesA=circle, CurvesB=polar_array.Geometry)
