# Grasshopper definition SquareShape.gh (Grasshopper 0.9.80)

number_slider = Slider(3, range=0..50)
number_slider_2 = Slider(13.2, range=0..30)
multiplication = Multiplication(A=number_slider, B=-0.5)
construct_domain = ConstructDomain(DomainStart=expr("-x/2", Slider(40, range=0..50)), DomainEnd=expr("x/2", Slider(40, range=0..50)))
# Domain used to center points of the sides of the rectangle
rectangle = Rectangle(Plane=PlaneXY(0, 0, 0), XSize=number_slider, YSize=number_slider_2, Radius=0)  # -> Rectangle, Length
construct_domain_2 = ConstructDomain(DomainStart=expr("-x/2", Slider(40, range=0..50)), DomainEnd=expr("x/2", Slider(40, range=0..50)))
# Functions used to center points of the slits
vector_xyz = VectorXYZ(XComponent=multiplication, YComponent=number_slider_2, ZComponent=0)  # -> Vector, Length
panel = Panel("Slits")
panel_2 = Panel("Main shape")
rectangle_2 = Rectangle(Plane=PlaneXY(0, 0, 0), XSize=construct_domain_2, YSize=construct_domain, Radius=0)  # -> Rectangle, Length
move = Move(Geometry=rectangle.Rectangle, Motion=vector_xyz.Vector)  # -> Geometry, Transform
polar_array = PolarArray(Geometry=move.Geometry, Plane=PlaneXY(0, 0, 0), Count=4, Angle=6.283185307)  # -> Geometry, Transform
# Function used to trim final shape
region_difference = RegionDifference(CurvesA=rectangle_2.Rectangle, CurvesB=polar_array.Geometry)
